# Grasshopper definition 140311_ShapeOp_GHPython_SoftwareArchitecture_01.gh (Grasshopper 0.9.76)
# plug-ins: Python Interpreter

# ---- group: Pick input mesh
list = ValueList({"100 Faces Simple A": 0, "100 Faces Simple B": 1, "2500 Faces Simple": 2, "38 Faces Complex": 3, "1862 Faces Complex": 4}, selected="100 Faces Simple A")
meshes = Mesh([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])
item = ListItem(List=meshes, Index=list, Wrap=False)

# ----
list_2 = ValueList({"Planarity": "shapeop_addPlaneConstraint", "Circle": "shapeop_addCircleConstraint", "Laplacian": "shapeop_addUniformLaplacianConstraint"}, selected="Planarity")
constraints = PythonScript(Mesh=item, Type=list_2, Weight=Slider(1000, range=0..1000))  # -> Constraints; inputs Mesh: Mesh
# ---------- constraints: Python ----------
if Mesh and Type and Weight:    
    
    if Type in ("shapeop_addPlaneConstraint","shapeop_addCircleConstraint"):
        
        # Make dict for storing shapeop constraint signatures
        Constraints = {"type":Type, "pointIndices":[], "weight":Weight}
        
        # Get list of face vertex indices and add to dict
        for i in range(Mesh.Faces.Count):
            fl = Mesh.Faces.Item[i]
            if fl.IsQuad:
                fIDs = (fl.A,fl.B,fl.C,fl.D)
            else:
                fIDs = (fl.A,fl.B,fl.C)
            Constraints["pointIndices"].append(fIDs)
            
    elif Type in ("shapeop_addUniformLaplacianConstraint",):
        
        # Make dict for storing shapeop constraint signatures
        Constraints = {"type":Type, "pointIndices":[], "weight":Weight}
        
        # Get list of face vertex neighbour indices
        for i in range(Mesh.Vertices.Count):
            vnIDs = [i] + list(Mesh.Vertices.GetConnectedVertices(i))
            Constraints["pointIndices"].append(vnIDs)
            
            
            
    # Output to GH (wrap in list to send as one item)
    Constraints = [Constraints,]
    
else:
    Constraints = []
# ---------- end constraints ----------

list_3 = ValueList({"Planarity": "shapeop_addPlaneConstraint", "Circle": "shapeop_addCircleConstraint", "Laplacian": "shapeop_addUniformLaplacianConstraint"}, selected="Laplacian")
constraints_2 = PythonScript(Mesh=item, Type=list_3, Weight=Slider(50, range=0..1000))  # -> Constraints; inputs Mesh: Mesh; same code as constraints

list_4 = ValueList({"Planarity": "shapeop_addPlaneConstraint", "Circle": "shapeop_addCircleConstraint", "Laplacian": "shapeop_addUniformLaplacianConstraint"}, selected="Circle")
constraints_3 = PythonScript(Mesh=item, Type=list_4, Weight=Slider(762.5, range=0..1000))  # -> Constraints; inputs Mesh: Mesh
# ---------- constraints_3: Python ----------
if Mesh and Type and Weight:    
    
    if Type in ("shapeop_addPlaneConstraint","shapeop_addCircleConstraint"):
        
        # Make dict for storing shapeop constraint signatures
        Constraints = {"type":Type, "pointIndices":[], "weight":Weight}
        
        # Get list of face vertex indices and add to dict
        for i in range(Mesh.Faces.Count):
            fl = Mesh.Faces.Item[i]
            if fl.IsQuad:
                fIDs = (fl.A,fl.B,fl.C,fl.D)
            else:
                fIDs = (fl.A,fl.B,fl.C)
            Constraints["pointIndices"].append(fIDs)
            
    elif Type in ("shapeop_addUniformLaplacianConstraint",):
        
        # Make dict for storing shapeop constraint signatures
        Constraints = {"type":Type, "pointIndices":[], "weight":Weight}
        
        # Get list of face vertex neighbour indices
        for i in range(Mesh.Vertices.Count):
            vnIDs = [i] + list(Mesh.Vertices.GetConnectedVertices(i))
            Constraints["pointIndices"].append(vnIDs)
            
            
    # Output to GH (wrap in list to send as one item)
    Constraints = [Constraints,]
    
else:
    Constraints = []
# ---------- end constraints_3 ----------

# ---- group: Deconstruct/Reconstruct Mesh
demesh = DeconstructMesh(Mesh=item)  # -> Vertices, Faces, Colours, Normals
planarity = BooleanToggle(True)

# ---- group: Solve
list_5 = ValueList({"0", "1", "50", "100", "300"}, selected="100")
solver = PythonScript(Points=demesh.Vertices, Constraints=[constraints, constraints_2, constraints_3], Iterations=list_5)  # -> out, Points; inputs Points: list of Point3d, Constraints: list, Iterations: Int32
# ---------- solver: Python ----------
import clr
import time
import Rhino as rc
import ctypes as ct
so = ct.cdll.LoadLibrary("ShapeOp.dll")


# Set up solver and constraints
if Points and Iterations and Constraints:
    
    # Make ShapeOp solver
    solver = so.shapeop_create()
    
    # Make ctypes double array containing points coordinates
    ptCoords = (ct.c_double * (len(Points)*3))()
    for i in range(len(Points)):
        b = 3*i
        ptCoords[b] = float(Points[i].X)
        ptCoords[b+1] = float(Points[i].Y)
        ptCoords[b+2] = float(Points[i].Z)
        
   # Add points coordinates to solver
    so.shapeop_setPoints(solver,ct.byref(ptCoords),len(Points))
    
    # Add closeness constraint (else the mesh jumps to the origin)
    for i in range(len(Points)):
        so.shapeop_addClosenessConstraint(solver,i,0.1)
    
    # Unpack constraints dict and add constraints to solver
    for csd in Constraints:
        
        # Case: Planarity
        if csd["type"] == "shapeop_addPlaneConstraint":
            for fIDs in csd["pointIndices"]:
                
                # Make ctypes integer array with face IDs
                faceIDs = (ct.c_int * len(fIDs))()
                for i,v in enumerate(fIDs):
                    faceIDs[i] = v
                    
                # Add the constraint
                so.shapeop_addPlaneConstraint(solver,ct.byref(faceIDs),len(fIDs),csd["weight"])
                
        # Case: circle
        elif csd["type"] == "shapeop_addCircleConstraint":
            for fIDs in csd["pointIndices"]:
                
                # Make ctypes integer array with face IDs
                faceIDs = (ct.c_int * len(fIDs))()
                for i,v in enumerate(fIDs):
                    faceIDs[i] = v
                    
                # Add the constraint
                so.shapeop_addCircleConstraint(solver,ct.byref(faceIDs),len(fIDs),csd["weight"])
                
        # Case: Laplacian
        elif csd["type"] == "shapeop_addUniformLaplacianConstraint":
            for vnIDs in csd["pointIndices"]:
                
                # Make ctype integer array with vertex neighbours
                neighbours = (ct.c_int*len(vnIDs))()
                for i,v in enumerate(vnIDs):
                    neighbours[i] = v
                    
                # Add the constraint
                so.shapeop_addUniformLaplacianConstraint(solver,ct.byref(neighbours),len(vnIDs),1,csd["weight"])
                
                
    # Initialize and solve
    so.shapeop_init(solver)
    startTime = time.time()
    so.shapeop_solve(solver,Iterations)
    print "SolveTime:",int((time.time()-startTime)*1000),'ms'
    
    # Update the points list
    so.shapeop_getPoints(solver,ct.byref(ptCoords),len(Points))
    for i in range(len(Points)):
        b = i*3
        Points[i] = rc.Geometry.Point3d(ptCoords[b],ptCoords[b+1],ptCoords[b+2])
        
    # Delete solver
    so.shapeop_delete(solver)
# ---------- end solver ----------
panel = Panel(solver.out)

# ---- group: Deconstruct/Reconstruct Mesh (continued)
conmesh = ConstructMesh(Vertices=solver.Points, Faces=demesh.Faces)
R = Render(mesh=conmesh, planarity=planarity)

# ==== cluster Render: Render to viewport.
mesh = ClusterInput()
planarity = ClusterInput()
gate = StreamGate(Stream=mesh, Planarity=planarity)  # -> Target0, Target1

material = CreateMaterial(
    Diffuse=ColourSwatch(SwatchColor=RGB(61, 61, 61)),
    Specular=ColourSwatch(SwatchColor=RGB(23, 23, 23)),
    Emission=ColourSwatch(SwatchColor=RGB(191, 191, 191)),
    Transparency=Slider(0.06, range=0..1),
    Shine=Slider(48, range=0..100))
preview = CustomPreview(Geometry=gate.Target0, Shader=material)

planaritydisplay = PlanarityDisplay(M=gate.Target1, I=Domain(0, 0.05), bool=False)  # -> num_2, M_2, C
material_2 = CreateMaterial(
    Diffuse=ColourSwatch(SwatchColor=RGB(0, 0, 0)),
    Specular=ColourSwatch(SwatchColor=RGB(84, 84, 84)),
    Emission=planaritydisplay.C,
    Transparency=Slider(0, range=0..1),
    Shine=Slider(0, range=0..100))
preview_2 = CustomPreview(Geometry=planaritydisplay.M_2, Shader=material_2)

# ==== cluster PlanarityDisplay: Creates colours for each face of a mesh, showing planarity levels
I = ClusterInput()
M = ClusterInput()
bool = ClusterInput()
domcomp = DomainComponents(Domain=I)  # -> Start, End
mcomp = Decompose(Mesh=M)  # -> Vertices, Faces, Colours, Normals
bool_2 = Boolean(bool)
vertices = FaceVertices(Face=mcomp.Faces)  # -> CornerA, CornerB, CornerC, CornerD
item = ListItem(List=mcomp.Vertices, Index=vertices.CornerA, Wrap=False)
item_2 = ListItem(List=mcomp.Vertices, Index=vertices.CornerB, Wrap=False)
item_3 = ListItem(List=mcomp.Vertices, Index=vertices.CornerC, Wrap=False)
item_4 = ListItem(List=mcomp.Vertices, Index=vertices.CornerD, Wrap=False)
quad = MeshQuad(CornerA=0, CornerB=1, CornerC=3, CornerD=2)
entwine = Entwine(Branch00=item, Branch01=item_2, Branch02=item_4, Branch03=item_3, FlattenInputs=True)
flip = FlipMatrix(Data=entwine)
dist = Distance(PointA=item_2, PointB=item_4)
dist_2 = Distance(PointA=item, PointB=item_3)
P = Planarity(Point1=item, Point2=item_2, Point3=item_3, Point4=item_4)  # -> flatten(Height)
mesh = Mesh(Vertices=flip, Faces=quad)  # -> flatten(Mesh)
avr = Average(Input=[dist_2, dist])  # -> flatten(ArithmeticMean)
M_2 = ClusterOutput(mesh)
division = Division(A=P, B=avr)
filter = StreamFilter(Gate=bool_2, Stream0=division, Stream1=P)  # -> flatten(Stream)
gradient = Gradient(
    LowerLimit=domcomp.Start,
    UpperLimit=domcomp.End,
    Parameter=filter,
    stops=[0: RGB(0, 128, 0), 0.5: RGB(255, 255, 0), 1: RGB(255, 0, 0)])
num = Number(filter)
C = ClusterOutput(gradient)
num_2 = ClusterOutput(num)
