# Grasshopper definition ShapeOpGHPython_Dynamic_PlanarityAndCircle.gh (Grasshopper 0.9.76)
# plug-ins: Python Interpreter

# ---- group: Pick input mesh and use its corners as anchors
# ShapeOp Optimize Mesh - Dynamic Version (140924)
list = ValueList({"100 Faces Simple A": 0, "100 Faces Simple B": 1, "2500 Faces Simple": 2, "38 Faces Complex": 3, "1862 Faces Complex": 4}, selected="1862 Faces Complex")
meshes = Mesh([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])
at = Slider(0, range=0..2)
item = ListItem(List=meshes, Index=list, Wrap=False)
meshcorners = MeshCorners(M=item, A=at)  # -> flatten(L)

# ---- group: Randomly move pts
M = Slider(0, range=0..10)
S = Slider(0, range=0..100)
python = PythonScript(Pts=meshcorners, M=M, S=S)  # -> MPts; inputs Pts: list of Point3d
# ---------- python: Python ----------
import Rhino as rc
import random as rd

if Pts:
    MPts = []
    for i,pt in enumerate(Pts):
        xyz = []
        for j in range(3):
            rd.seed(i+j+S)
            xyz.append(rd.uniform(-1.0,1.0))
        vec = rc.Geometry.Vector3d(xyz[0],xyz[1],xyz[2])
        vec = vec * M
        MPts.append(pt+vec)
# ---------- end python ----------

# ---- group: Free Anchor Points
anchorstarget = Point([Point(2.385352573, 25.61156991, 9.352028304), Point(20.52633502, 22.75174276, -1.372524551), Point(15.61272687, 2.351816276, -3.150187218), Point(1.364032118, 4.422254275, -2.095572098), Point(14.49697917, 11.67157367, 11.95204758)])
anchorsstart = Point([Point(5.502789974, 23.26885414, 1.658420563), Point(23.19257927, 23.26885414, 0), Point(18.21733665, 5.57905817, -2.211218834), Point(5.502789974, 5.57905817, 0), Point(16.29578209, 14.5135107, 9.701752663)])

# ---- group: Anchors - 1862 Faces Complex
anchorstarget_2 = Point([Point(19.06016484, 36.90996031, -4.10436931), Point(3.298816321, 17.27980042, 11.83758505), Point(36.05744741, 12.92996311, 19.02453689), Point(12.28450871, 5.645508539, 14.32495063)])
anchorsstart_2 = Point([Point(19.94771576, 23.03427505, 1.912926316), Point(6.912346363, 17.27980042, 2.148720026), Point(24.5273056, 12.92996311, 2.076173067), Point(12.28450871, 6.978881359, 2.827125072)])

# ---- group: ShapeOp Optimize Mesh - Dynamic Version
mass = Slider(1, range=0..1)
dynamic = BooleanToggle(True)
reset = Button()
run = BooleanToggle(False)
anchorst = Point(anchorstarget_2)
anchors = Point(anchorsstart_2)
mesh = Mesh(item)
shapeopdynamic = PythonScript(
    Mesh=mesh,
    Anchors=anchors,
    AnchorsT=anchorst,
    AnchorW=Slider(2000, range=0..2000),
    LaplacianW=Slider(500, range=0..1000),
    PlanarityW=Slider(1000, range=0..1000),
    CircleW=Slider(1000, range=0..1000),
    SubIterations=Slider(2, range=1..20),
    Mass=mass,
    Damping=Slider(0.9, range=0..1),
    TimeStep=Slider(0.5, range=0.1..1),
    Dynamic=dynamic,
    Run=run,
    Reset=reset)  # -> Out, Iterations, Mesh; inputs Mesh: Mesh, Anchors: list of Point3d, AnchorsT: list of Point3d, SubIterations: Int32, Dynamic: Boolean, Run: Boolean, Reset: Boolean
# ---------- shapeopdynamic: Python ----------
"""
Demonstration example of how to implement the ShapeOp C++ library (shapeop.org)
in Grasshopper using Python and the foreign function library ctypes (docs.python.org/2/library/ctypes).
Uses the Plankton mesh library (github.com/Dan-Piker/Plankton).
-
Name: ShapeOpGHPython_Dynamic_PlanarityAndCircle
Updated: 140924
Author: Anders Holden Deleuran (CITA/KADK)
Copyright: Mozilla Public License Version 2.0
Contact: adel@kadk.dk

    Args:
        Mesh: Mesh to optimize/form find.
        Anchors: List of points which to anchor.
        AnchorsT: List of points which to anchor to.
        AnchorW: Anchor constraint weight (0.0-2000-ish).
        LaplacianW: Laplacian constraint weight (0.0-2000-ish).
        PlanarityW: Planarity constraint weight (0.0-2000-ish).
        CircleW: Circle constraint weight (0.0-2000-ish).
        SubIterations: Amount of sub-iterations to run at each solve step (1-20-ish).
        Mass: Particle mass value (0.0-1.0).
        Damping: Particle damping value (0.0-1.0).
        TimeStep: TODO
        Dynamic: It True the solver is initialized using Mass and Damping.
        Run: Toggle the solver on/off.
        Reset: Resets the mesh and updates all constraints.
    Returns:
        Iterations: Number of iterative solve steps.
        Mesh: The optimized/form found mesh.
"""

import clr
import time
import Rhino as rc
import ctypes as ct
import Grasshopper as gh
from scriptcontext import sticky as st
so = ct.cdll.LoadLibrary("ShapeOp.dll")
clr.AddReferenceToFile("Plankton.gha")
import PlanktonGh as plgh


def addMeshVertexCoordinates(solver,mesh):
    
    """ Convert a Rhino mesh to a Plankton mesh and add its verticesto a ShapeOp solver """
    
    # Make plankton mesh and get its vertices and count
    pMesh = plgh.RhinoSupport.ToPlanktonMesh(Mesh)
    vertices = pMesh.Vertices
    vCount = vertices.Count
    
    # Make ctypes double array containing vertex coordinates
    vCoords = (ct.c_double * (vCount*3))()
    for i in range(vCount):
        b = 3*i
        vCoords[b] = float(vertices[i].X)
        vCoords[b+1] = float(vertices[i].Y)
        vCoords[b+2] = float(vertices[i].Z)
        
    # Add vertex coordinates to solver
    so.shapeop_setPoints(solver,ct.byref(vCoords),vCount)
    
    return pMesh,vCoords

def addAnchorConstraints(solver,pMesh,anchorsPts,weight):
    
    """ Add anchor/point closeness constraints to a Plankton mesh """
    
    if anchorsPts and weight > 0:
        
        anchorIds = (ct.c_int*len(anchorsPts))()
        for i,apt in enumerate(anchorsPts):
            for j in range(pMesh.Vertices.Count):
                vtxC = pMesh.Vertices[j].ToXYZ()
                vtxPt = rc.Geometry.Point3d(vtxC.X,vtxC.Y,vtxC.Z)
                if apt.DistanceTo(vtxPt) < 0.01:
                    aid = so.shapeop_addClosenessConstraint(solver,j,weight)
                    anchorIds[i] = aid
                    
        return anchorIds

def addLaplacianConstraints(solver,pMesh,weight):
    
    """ Add Laplacian constraints to a Plankton mesh """
    
    if weight > 0:
        
        for i in range(pMesh.Vertices.Count):
            
            # Get neighbour indices and amount
            neighboursPy = [i] + list(pMesh.Vertices.GetVertexNeighbours(i))
            amount = len(neighboursPy)
            
            # Make ctype integer array
            neighbours = (ct.c_int*amount)()
            for i,v in enumerate(neighboursPy):
                neighbours[i] = v
                
            # Add constraint
            so.shapeop_addUniformLaplacianConstraint(solver,ct.byref(neighbours),amount,1,weight)

def addPlanarityConstraints(solver,pMesh,weight):
    
    """ Add planarity constraints to a Plankton mesh """
    
    if weight > 0:
    
        faceList = pMesh.Faces
        for i in range(faceList.Count):
            
            # Get face vertices and amount
            faceVerticesPy = faceList.GetFaceVertices(i)
            amount = len(faceVerticesPy)
            
            # Convert to ctypes integer array
            faceVertices = (ct.c_int*amount)()
            for i,v in enumerate(faceVerticesPy):
                faceVertices[i] = v
                
            # Add constraints
            so.shapeop_addPlaneConstraint(solver,ct.byref(faceVertices),amount,weight)

def addCircleConstraints(solver,pMesh,weight):
    
    """ Add circle constraints to a Plankton mesh """
    
    if weight > 0:
        
        faceList = pMesh.Faces
        for i in range(faceList.Count):
            
            # Get face vertices and amount
            faceVerticesPy = faceList.GetFaceVertices(i)
            amount = len(faceVerticesPy)
            
            # Convert to ctypes integer array
            faceVertices = (ct.c_int*amount)()
            for i,v in enumerate(faceVerticesPy):
                faceVertices[i] = v
                
            # Add constraints
            so.shapeop_addCircleConstraint(solver,ct.byref(faceVertices),amount,weight)

def ghComponentTimer(run,interval):
    
    """ Update the component at the interval like using a GH timer """
    
    # Ensure interval is larger than zero
    if interval <= 0:
        interval = 1
        
    # Get the Grasshopper document and component that owns this script
    ghComp = ghenv.Component
    ghDoc = ghComp.OnPingDocument()
    
    # Define the callback function
    def callBack(ghDoc):
        ghComp.ExpireSolution(False)
        
    # Update the solution
    if run:
        ghDoc.ScheduleSolution(interval,gh.Kernel.GH_Document.GH_ScheduleDelegate(callBack))

if Mesh:
    
    # Get GH component guid and make unique variable names for sticky keys
    guid = str(ghenv.Component.InstanceGuid)
    solver = "solver_" + guid
    pMesh = "pMesh_" + guid
    vCoords = "vCoords_" + guid
    anchors = "anchors_" + guid
    iterations = "iterations_" + guid
    
    # Make solver and add constraints
    if solver not in st:
        
        # Make ShapeOp solver
        st[solver] = so.shapeop_create()
        
        # Make plankton mesh and add its vertex coordinates to the solver
        st[pMesh],st[vCoords] = addMeshVertexCoordinates(st[solver],Mesh)
        
        # Add anchor closeness constraints which can be edited live
        st[anchors] = addAnchorConstraints(st[solver],st[pMesh],Anchors,AnchorW)
        
        # Add non-live editable constraints
        addLaplacianConstraints(st[solver],st[pMesh],LaplacianW)
        addPlanarityConstraints(st[solver],st[pMesh],PlanarityW)
        addCircleConstraints(st[solver],st[pMesh],CircleW)
        
        # Initialize the solver
        if Dynamic:
            so.shapeop_initDynamic(st[solver],Mass,Damping,TimeStep)
        else:
            so.shapeop_init(st[solver])
            
        # Make iteration counter
        st[iterations] = 0
        
    # Run solver live
    if Run:
        
        # Set new target anchor points
        if AnchorsT and st[anchors]:
            for i,id in enumerate(st[anchors]):
                apt = AnchorsT[i]
                apt = (ct.c_double*3)(apt.X,apt.Y,apt.Z)
                so.shapeop_editClosenessConstraint(st[solver],id,ct.byref(apt))
            
        # Solve and get the vertex coordinates
        startTime = time.time()
        so.shapeop_solve(st[solver],SubIterations)
        st[iterations] += 1
        so.shapeop_getPoints(st[solver],ct.byref(st[vCoords]),st[pMesh].Vertices.Count)
        print "SolveTime:",int((time.time()-startTime)*1000),'ms'
        
    # Set plankton mesh vertices
    for i in range(st[pMesh].Vertices.Count):
        b = i*3
        st[pMesh].Vertices.SetVertex(i,st[vCoords][b],st[vCoords][b+1],st[vCoords][b+2])
        
    # Convert plankton mesh to Rhino mesh and compute normals
    Mesh = plgh.RhinoSupport.ToRhinoMesh(st[pMesh])
    Mesh.FaceNormals.ComputeFaceNormals()
    Mesh.Normals.ComputeNormals()
    
    # Increment iterations
    Iterations = st[iterations]*SubIterations
    
    # Reset model
    if Reset:
        del st[solver]
        del st[pMesh]
        del st[vCoords]
        del st[anchors]
        del st[iterations]
        
    # Update the component
    ghComponentTimer(Run,5)
# ---------- end shapeopdynamic ----------
panel = Panel(shapeopdynamic.Out)
panel_2 = Panel(shapeopdynamic.Iterations)

# ---- group: ShapeOp Optimize Mesh - Dynamic Version / Render to ViewPort
planarity = BooleanToggle(False)
R = Render(mesh=shapeopdynamic.Mesh, planarity=planarity)

# ---- group: Anchors
cluster = Cluster(pt=anchors, B=anchorst)

# ==== cluster Render: Render to viewport.
mesh = ClusterInput()
planarity = ClusterInput()
gate = StreamGate(Stream=mesh, Planarity=planarity)  # -> Target0, Target1

material = CreateMaterial(
    Diffuse=ColourSwatch(SwatchColor=RGB(61, 61, 61)),
    Specular=ColourSwatch(SwatchColor=RGB(23, 23, 23)),
    Emission=ColourSwatch(SwatchColor=RGB(191, 191, 191)),
    Transparency=Slider(0.06, range=0..1),
    Shine=Slider(48, range=0..100))
preview = CustomPreview(Geometry=gate.Target0, Shader=material)

planaritydisplay = PlanarityDisplay(M=gate.Target1, I=Domain(0, 0.05), bool=False)  # -> num_2, M_2, C
material_2 = CreateMaterial(
    Diffuse=ColourSwatch(SwatchColor=RGB(0, 0, 0)),
    Specular=ColourSwatch(SwatchColor=RGB(84, 84, 84)),
    Emission=planaritydisplay.C,
    Transparency=Slider(0, range=0..1),
    Shine=Slider(0, range=0..100))
preview_2 = CustomPreview(Geometry=planaritydisplay.M_2, Shader=material_2)

# ==== cluster MeshCorners: Finds the corners of the boundary of a mesh
M = ClusterInput()
medges = MeshEdges(Mesh=M)  # -> NakedEdges, InteriorEdges, NonManifoldEdges
join = JoinCurves(Curves=medges.NakedEdges, Preserve=False)
explode = Explode(Curve=join, Recursive=True)  # -> simplify(Segments), Vertices
shift = ShiftList(List=explode.Segments, Shift=1, Wrap=True)  # -> simplify(List)
end = EndPoints(Curve=explode.Segments)  # -> Start, End
angle = Angle(VectorA=explode.Segments, VectorB=shift)  # -> Angle, Reflex
A = ClusterInput()
smaller = SmallerThan(FirstNumber=A, SecondNumber=angle.Angle)  # -> SmallerThan, OrEqualTo
cull = CullPattern(List=end.End, CullPattern=smaller.SmallerThan)  # -> flatten(List)
L = ClusterOutput(cull)

# ==== cluster Cluster
pt = ClusterInput()
B = ClusterInput()
pt_2 = Point(pt)
vec2pt = Vector2Pt(PointA=pt_2, PointB=B, Unitize=False)  # -> Vector, Length
vdisex = VectorDisplayEx(Point=pt_2, Vector=vec2pt.Vector, Colour=ColourSwatch(SwatchColor=RGB(255, 0, 0)), Width=1)

# ==== cluster PlanarityDisplay: Creates colours for each face of a mesh, showing planarity levels
I = ClusterInput()
M = ClusterInput()
bool = ClusterInput()
domcomp = DomainComponents(Domain=I)  # -> Start, End
mcomp = Decompose(Mesh=M)  # -> Vertices, Faces, Colours, Normals
bool_2 = Boolean(bool)
vertices = FaceVertices(Face=mcomp.Faces)  # -> CornerA, CornerB, CornerC, CornerD
item = ListItem(List=mcomp.Vertices, Index=vertices.CornerA, Wrap=False)
item_2 = ListItem(List=mcomp.Vertices, Index=vertices.CornerB, Wrap=False)
item_3 = ListItem(List=mcomp.Vertices, Index=vertices.CornerC, Wrap=False)
item_4 = ListItem(List=mcomp.Vertices, Index=vertices.CornerD, Wrap=False)
quad = MeshQuad(CornerA=0, CornerB=1, CornerC=3, CornerD=2)
entwine = Entwine(Branch00=item, Branch01=item_2, Branch02=item_4, Branch03=item_3, FlattenInputs=True)
flip = FlipMatrix(Data=entwine)
dist = Distance(PointA=item_2, PointB=item_4)
dist_2 = Distance(PointA=item, PointB=item_3)
P = Planarity(Point1=item, Point2=item_2, Point3=item_3, Point4=item_4)  # -> flatten(Height)
mesh = Mesh(Vertices=flip, Faces=quad)  # -> flatten(Mesh)
avr = Average(Input=[dist_2, dist])  # -> flatten(ArithmeticMean)
M_2 = ClusterOutput(mesh)
division = Division(A=P, B=avr)
filter = StreamFilter(Gate=bool_2, Stream0=division, Stream1=P)  # -> flatten(Stream)
gradient = Gradient(
    LowerLimit=domcomp.Start,
    UpperLimit=domcomp.End,
    Parameter=filter,
    stops=[0: RGB(0, 128, 0), 0.5: RGB(255, 255, 0), 1: RGB(255, 0, 0)])
num = Number(filter)
C = ClusterOutput(gradient)
num_2 = ClusterOutput(num)
